# Grasshopper definition SDFs_Generator_Hops_test.gh (Grasshopper 1.0.8)
# plug-ins: Hops

path = FilePath("https://github.com/ramon-garcia-ayala/SDFs_Generator/raw/refs/heads/main/SDFs_Generator_V1.0.0.gh")
hops = Hops(
    _Path=path,
    GetNumber=Slider(3, range=0..100),
    CacheResultsInMemory=True,
    CacheSolveResults=True,
    RemoteDefinitionLocation="https://github.com/ramon-garcia-ayala/SDFs_Generator/raw/refs/heads/main/SDFs_Generator_V1.0.0.gh",
    RemoteSolveVersion=(0, 1, 0),
    ShowInput_Enabled=False,
    ShowInput_Path=True,
    SynchronousSolve=True)
geo = Geometry(hops)
