# Grasshopper definition SDFs_Generator_V1.0.0.gh (Grasshopper 1.0.8)
# plug-ins: Axolotl Info

get_number = GetNumber(Slider(11, range=0..100), AtLeast=1, AtMost=1, Maximum=1.797693135e+308, Minimum=-1.797693135e+308, TreeAccess=False)
test_numero_x = GetNumber(Slider(28, range=0..100), AtLeast=1, AtMost=1, Maximum=1.797693135e+308, Minimum=-1.797693135e+308, TreeAccess=False)
box = Box(DimensionX=get_number, DimensionY=get_number, DimensionZ=get_number, Radius=0, Plane=PlaneXY(0, 0, 0))
tpms = TPMS(Wavelength=get_number, type=0)
dense_grid = DenseGrid(
    DistanceObject=tpms,
    Box={Plane=PlaneXY(0, 0, 0), X=Domain(-5, 5), Y=Domain(-5, 5), Z=Domain(-5, 5)},
    NumberX=get_number,
    NumberY=[Slider(11, range=0..100), get_number],
    NumberZ=50,
    type=0)  # -> Values, Points
pline = PolyLine(Vertices=dense_grid.Points, Closed=False)
c_bake = ContextBake(Content=pline)
c_print = ContextPrint(Text=pline)
